# Grasshopper definition Point and curve attractor_hops.gh (Grasshopper 1.0.8)

u_count = GetNumber(Slider(20, range=0..100), AtLeast=1, AtMost=1, Maximum=1.797693135e+308, Minimum=-1.797693135e+308, TreeAccess=False)
v_count = GetNumber(Slider(10, range=0..100), AtLeast=1, AtMost=1, Maximum=1.797693135e+308, Minimum=-1.797693135e+308, TreeAccess=False)
plane_surface = PlaneSurface(Plane=PlaneXY(0, 0, 0), XSize=Slider(200, range=0..1000), YSize=Slider(100, range=0..1000))
divide_domain² = DivideDomain²(Domain=plane_surface, UCount=u_count, VCount=v_count)
populate_2d = Populate2D(Region=plane_surface, Count=Slider(2, range=0..10), Seed=1)
isotrim = Isotrim(Surface=plane_surface, Domain=divide_domain²)
md_slider = MDSlider(SliderMode=0, slider_value=Point(0.5, 0.5, 0.5), x_domain=Domain(0, 1), y_domain=Domain(0, 1), z_domain=Domain(0, 1))
evaluate_surface = EvaluateSurface(Surface=reparameterize(isotrim), Point=md_slider)  # -> Point, Normal, UDirection, VDirection, Frame
pull_point = PullPoint(Point=evaluate_surface.Point, Geometry=populate_2d, ClosestOnly=True)  # -> ClosestPoint, Distance
construct_domain = ConstructDomain(DomainStart=Slider(5, range=0..100), DomainEnd=Slider(1, range=0..1000))
bounds = Bounds(Numbers=pull_point.Distance)
remap_numbers = RemapNumbers(Value=pull_point.Distance, Source=bounds, Target=construct_domain)  # -> Mapped, Clipped
deconstruct_brep = DeconstructBrep(Brep=isotrim)  # -> Faces, Edges, Vertices
circle_cnr = CircleCNR(Center=evaluate_surface.Point, Normal=evaluate_surface.Normal, Radius=remap_numbers.Mapped)
join_curves = JoinCurves(Curves=deconstruct_brep.Edges, Preserve=False)
graft_tree = GraftTree(Tree=evaluate_surface.Normal, IncludeEmptyLists=True, IncludeNullItems=True)
graft_tree_2 = GraftTree(Tree=circle_cnr, IncludeEmptyLists=True, IncludeNullItems=True)
graft_tree_3 = GraftTree(Tree=evaluate_surface.Normal, IncludeEmptyLists=True, IncludeNullItems=True)
multiplication = Multiplication(A=graft_tree, B=Slider(0.7, range=0..100))
multiplication_2 = Multiplication(A=graft_tree_3, B=Slider(0.5, range=0..100))
extrude = Extrude(Base=graft_tree_2, Direction=multiplication)
extrude_2 = Extrude(Base=join_curves, Direction=multiplication_2)
cap_holes = CapHoles(Brep=extrude_2)
cap_holes_2 = CapHoles(Brep=extrude)
solid_difference = SolidDifference(BrepsA=cap_holes, BrepsB=cap_holes_2)
context_bake = ContextBake(Content=solid_difference)
